# Grasshopper definition py_in_gh.gh (Grasshopper 1.0.8)

path = FilePath("C:\Users\david\Desktop\Session02\session02\workflow\py-in-gh.py")
file = ReadFile(File=path, PerLineParse=False)
cir = Circle(Plane=PlaneXY(0, 0, 0), Radius=1)
py3 = Python3Script(script=file, x=cir, y=Slider(8, range=0..10))  # -> out, a, b; inputs x: Circle; unedited script template
