# Grasshopper definition A03_Jaume_Monclus.gh (Grasshopper 1.0.8)
# plug-ins: LunchBox, Weaverbird

torus = TorusSurface(
    UDivisions=90,
    VDivisions=96,
    CParameter=4,
    RParameter=2,
    TParameter=1,
    Scale=5,
    Domain1=Domain(0, 6.283185307),
    Domain2=Domain(-3.141592654, 3.141592654))
# Visual studio to grasshopper
panel = Panel("C:\Users\jaume\Desktop\MPDA\AT_APY\session_3\A03_Jaume_Monclus.py")
qrsettings = QuadRemeshSettings(
    TargetCount=Slider(250, range=0..1000),
    AdaptiveSize=0,
    AdaptiveCount=False,
    HardEdges=False,
    SeamEdges=0,
    Symmetry=Slider(1, range=0..3),
    GuideCurves=0)
number_slider = Slider(0, range=0..10)
qrmesh = QuadRemesh(Geometry=torus, Settings=qrsettings)
path = FilePath(panel)
file = ReadFile(File=path, PerLineParse=False)
py3 = Python3Script()  # -> out, a
# ---------- py3: Python ----------
import KangarooSolver as KS

KS.Util.
# ---------- end py3 ----------
py3_2 = Python3Script(script=file, m=qrmesh, s=Slider(27, range=0..200))  # -> out, a, b, pts, SP, c, ts, m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
panel_2 = Panel(py3_2.joined_first_meshes)

mesh = Mesh(graft(py3_2.joined_first_meshes))
mesh_2 = Mesh(graft(py3_2.joined_second_meshes))

# ----
# Unroller is not in
#  the KG library?
clean = CombineClean(Meshes=mesh)
clean_2 = CombineClean(Meshes=mesh_2)
unroller = Unroller(Strip=clean, Unroll=1)
unroller_2 = Unroller(Strip=clean_2, Unroll=1)

# ----
# Local Solution for
# unrolling and nesting
#  2 stripes
bang = ExplodeTree(Data=unroller_2)
bang_2 = ExplodeTree(Data=unroller)

wbnaked = WeaverbirdsNakedBoundary(MeshClosedPolylines=bang_2)
wbnaked_2 = WeaverbirdsNakedBoundary(MeshClosedPolylines=bang)
md_slider = MDSlider(SliderMode=0, slider_value=Point(0.5, 0.5, 0.5), x_domain=Domain(0, 1), y_domain=Domain(0, 1), z_domain=Domain(0, 1))
md_slider_2 = MDSlider(SliderMode=0, slider_value=Point(0.5, 0.5, 0.5), x_domain=Domain(0, 1), y_domain=Domain(0, 1), z_domain=Domain(0, 1))
patch = Patch(Curves=wbnaked, Spans=20, Flexibility=1, Trim=True)
patch_2 = Patch(Curves=wbnaked_2, Spans=20, Flexibility=1, Trim=True)
evalsrf = EvaluateSurface(Surface=reparameterize(patch), Point=md_slider)  # -> Point, Normal, UDirection, VDirection, Frame
evalsrf_2 = EvaluateSurface(Surface=reparameterize(patch_2), Point=md_slider_2)  # -> Point, Normal, UDirection, VDirection, Frame
vdis = VectorDisplay(Anchor=evalsrf.Point, Vector=evalsrf.Normal)
vdis_2 = VectorDisplay(Anchor=evalsrf_2.Point, Vector=evalsrf_2.Normal)
pl = PlaneNormal(Origin=evalsrf.Point, ZAxis=evalsrf.Normal)
pl_2 = PlaneNormal(Origin=evalsrf_2.Point, ZAxis=evalsrf_2.Normal)
orient = Orient(Geometry=bang, Source=pl_2, Target=PlaneXY(0, 0, 0))  # -> Geometry, Transform
pt = ConstructPoint(XCoordinate=0, YCoordinate=Slider(7, range=0..10), ZCoordinate=0)
xy = XYPlane(Origin=pt)
orient_2 = Orient(Geometry=bang_2, Source=pl, Target=xy)  # -> Geometry, Transform
mesh_3 = Mesh(orient_2.Geometry)
mesh_4 = Mesh(orient.Geometry)
