# Grasshopper definition A04_JaumeMonclus_TomasPerez_V2.gh (Grasshopper 1.0.8)
# plug-ins: MeshEdit Components, NGon, opennest_2 Info, LunchBox, Weaverbird, froGH

torus = TorusSurface(
    UDivisions=90,
    VDivisions=96,
    CParameter=4,
    RParameter=2,
    TParameter=1,
    Scale=5,
    Domain1=Domain(0, 6.283185307),
    Domain2=Domain(-3.141592654, 3.141592654))
# Visual studio to grasshopper
panel = Panel("C:\Users\jaume\Desktop\MPDA\AT_APY\session_3\A03_Jaume_Monclus.py")
qrsettings = QuadRemeshSettings(
    TargetCount=Slider(250, range=0..1000),
    AdaptiveSize=0,
    AdaptiveCount=False,
    HardEdges=False,
    SeamEdges=0,
    Symmetry=Slider(1, range=0..3),
    GuideCurves=0)
number_slider = Slider(0, range=0..10)
qrmesh = QuadRemesh(Geometry=torus, Settings=qrsettings)
path = FilePath("C:\Users\tsper\Desktop\Archivos Jauma\A03_Jaume_Monclus.py")
path_2 = FilePath(panel)
file = ReadFile(File=path, PerLineParse=False)
py3 = Python3Script()  # -> out, a
# ---------- py3: Python ----------
import KangarooSolver as KS

KS.Util.
# ---------- end py3 ----------
py3_2 = Python3Script(script=file, m=qrmesh, s=Slider(27, range=0..200))  # -> out, a, b, pts, SP, c, ts, m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
panel_2 = Panel(py3_2.joined_first_meshes)

mesh = Mesh(graft(py3_2.joined_first_meshes))
mesh_2 = Mesh(graft(py3_2.joined_second_meshes))

# ----
# Unroller is not in
#  the KG library?
clean = CombineClean(Meshes=mesh)
clean_2 = CombineClean(Meshes=mesh_2)
unroller = Unroller(Strip=clean, Unroll=1)
unroller_2 = Unroller(Strip=clean_2, Unroll=1)

item = ListItem(List=flatten(unroller_2), Index=Slider(29, range=0..100), Wrap=True)

# ----
# Local Solution for
# unrolling and nesting
#  2 stripes
bang = ExplodeTree(Data=unroller_2)
bang_2 = ExplodeTree(Data=unroller)

unroller_3 = Unroller(Strip=clean, Unroll=1)  # -> flatten(Unrolled)
unroller_4 = Unroller(Strip=clean_2, Unroll=1)  # -> flatten(Unrolled)
item_2 = ListItem(List=unroller_3, Index=0, Wrap=True)
wbnaked = WeaverbirdsNakedBoundary(MeshClosedPolylines=bang_2)
wbnaked_2 = WeaverbirdsNakedBoundary(MeshClosedPolylines=bang)
md_slider = MDSlider(SliderMode=0, slider_value=Point(0.5, 0.5, 0.5), x_domain=Domain(0, 1), y_domain=Domain(0, 1), z_domain=Domain(0, 1))
md_slider_2 = MDSlider(SliderMode=0, slider_value=Point(0.5, 0.5, 0.5), x_domain=Domain(0, 1), y_domain=Domain(0, 1), z_domain=Domain(0, 1))
patch = Patch(Curves=wbnaked, Spans=20, Flexibility=1, Trim=True)
patch_2 = Patch(Curves=wbnaked_2, Spans=20, Flexibility=1, Trim=True)

# ---- group: Unroll + Orient on Ground
item_3 = ListItem(List=flatten(unroller_3), Index=0, Wrap=True)
mc = MeshCorners(Mesh=unroller_3, Angle=Slider(2.93, range=0..10))
lng = ListLength(List=unroller_3)
item_4 = ListItem(List=mc, Index=0, Wrap=True)  # -> Item, Item1, Item2, Item3
series = Series(Start=0, Step=Slider(20, range=0..100), Count=lng)
mc_2 = MeshCorners(Mesh=item_3, Angle=Slider(2.93, range=0..10))
pt = ConstructPoint(XCoordinate=series, YCoordinate=0, ZCoordinate=0)
pl_3pt = Plane3Pt(PointA=item_4.Item3, PointB=item_4.Item1, PointC=item_4.Item)  # -> flatten(Plane)
xy = XYPlane(Origin=pt)
orient = Orient(Geometry=unroller_3, Source=pl_3pt, Target=xy)  # -> Geometry, Transform

# ----
item_5 = ListItem(List=flatten(unroller_4), Index=0, Wrap=True)
mc_3 = MeshCorners(Mesh=unroller_4, Angle=Slider(2.93, range=0..10))
lng_2 = ListLength(List=unroller_4)
item_6 = ListItem(List=mc_3, Index=0, Wrap=True)  # -> Item, Item1, Item2, Item3
series_2 = Series(Start=0, Step=Slider(10, range=0..100), Count=lng_2)
mc_4 = MeshCorners(Mesh=item_5, Angle=Slider(2.93, range=0..10))
pt_2 = ConstructPoint(XCoordinate=series_2, YCoordinate=0, ZCoordinate=0)
pt_3 = Point(item_6.Item3)
pl_3pt_2 = Plane3Pt(PointA=item_6.Item3, PointB=item_6.Item1, PointC=item_6.Item)  # -> flatten(Plane)
xy_2 = XYPlane(Origin=pt_2)
orient_2 = Orient(Geometry=unroller_4, Source=pl_3pt_2, Target=xy_2)  # -> Geometry, Transform

evalsrf = EvaluateSurface(Surface=reparameterize(patch), Point=md_slider)  # -> Point, Normal, UDirection, VDirection, Frame
evalsrf_2 = EvaluateSurface(Surface=reparameterize(patch_2), Point=md_slider_2)  # -> Point, Normal, UDirection, VDirection, Frame
vdis = VectorDisplay(Anchor=evalsrf.Point, Vector=evalsrf.Normal)
vdis_2 = VectorDisplay(Anchor=evalsrf_2.Point, Vector=evalsrf_2.Normal)
pl = PlaneNormal(Origin=evalsrf.Point, ZAxis=evalsrf.Normal)
pl_2 = PlaneNormal(Origin=evalsrf_2.Point, ZAxis=evalsrf_2.Normal)
orient_3 = Orient(Geometry=bang, Source=pl_2, Target=PlaneXY(0, 0, 0))  # -> Geometry, Transform
pt_4 = Point(item_4.Item3)
pt_5 = ConstructPoint(XCoordinate=0, YCoordinate=Slider(7, range=0..10), ZCoordinate=0)
xy_3 = XYPlane(Origin=pt_5)
orient_4 = Orient(Geometry=bang_2, Source=pl, Target=xy_3)  # -> Geometry, Transform
mesh_3 = Mesh(orient_4.Geometry)
mesh_4 = Mesh(orient_3.Geometry)

# ---- group: Straighten the Strips
mc_5 = MeshCorners(Mesh=orient.Geometry, Angle=Slider(2.93, range=0..10))
item_7 = ListItem(List=mc_5, Index=0, Wrap=True)  # -> Item, Item1, Item2, Item3
Y = UnitY(Factor=1)
line = LineSDL(Start=item_7.Item3, Direction=Y, Length=1)
ln = Line(StartPoint=item_7.Item3, EndPoint=item_7.Item1)
angle = Angle(VectorA=ln, VectorB=line)  # -> flatten(Angle), Reflex
rotate = Rotate(Geometry=orient.Geometry, Angle=angle.Angle, Plane=flatten(item_7.Item3))  # -> Geometry, Transform

# ----
mc_6 = MeshCorners(Mesh=orient_2.Geometry, Angle=Slider(2.93, range=0..10))
item_8 = ListItem(List=mc_6, Index=0, Wrap=True)  # -> Item, Item1, Item2, Item3
Y_2 = UnitY(Factor=1)
line_2 = LineSDL(Start=item_8.Item3, Direction=Y_2, Length=1)
ln_2 = Line(StartPoint=item_8.Item3, EndPoint=item_8.Item1)
angle_2 = Angle(VectorA=ln_2, VectorB=line_2)  # -> flatten(Angle), Reflex
rotate_2 = Rotate(Geometry=orient_2.Geometry, Angle=angle_2.Angle, Plane=flatten(item_8.Item3))  # -> Geometry, Transform

nv = NakedVertices(Mesh=rotate_2.Geometry)  # -> ClothedIndex, NakedIndex, ClothedPts, NakedPts
naked = NakedVertices(Mesh=rotate_2.Geometry)  # -> Vertices, Status
wbnaked_3 = WeaverbirdsNakedBoundary(MeshClosedPolylines=rotate_2.Geometry)
patch_3 = Patch(Curves=graft(wbnaked_3), Spans=20, Flexibility=1, Trim=True)  # -> flatten(Patch)
item_9 = ListItem(List=patch_3, Index=0, Wrap=True)
flip = Flip(Surface=patch_3, Guide=item_9)  # -> Surface, Result
md_slider_3 = MDSlider(SliderMode=0, slider_value=Point(0.5, 0.5, 0.5), x_domain=Domain(0, 1), y_domain=Domain(0, 1), z_domain=Domain(0, 1))
evalsrf_3 = EvaluateSurface(Surface=reparameterize(flip.Surface), Point=md_slider_3)  # -> Point, Normal, UDirection, VDirection, Frame
geo = Geometry(evalsrf_3.Point)
vdis_3 = VectorDisplay(Anchor=geo, Vector=evalsrf_3.Normal)
panel_3 = Panel(evalsrf_3.Normal)

bbox = BoundingBox(Content=rotate_2.Geometry, Plane=PlaneXY(0, 0, 0))  # -> Box, Box_2
debox = DeconstructBox(Box=bbox.Box)  # -> Plane, X, Y, Z
debrep = DeconstructBrep(Brep=bbox.Box)  # -> Faces, Edges, Vertices
num = Number(debox.X)
item_10 = ListItem(List=debrep.Vertices, Index=0, Wrap=True)
addition = Addition(A=num, B=Slider(0.45, range=0..1))
ma = MassAddition(Input=addition)  # -> Result, PartialResults
panel_4 = Panel(ma.PartialResults)
cull_i = CullIndex(List=ma.PartialResults, Indices=Slider(-1, range=-1..0), Wrap=True)
merge = Merge(Data1=Slider(0, range=0..100), Data2=cull_i)  # -> flatten(Result)
pt_6 = ConstructPoint(XCoordinate=merge, YCoordinate=0, ZCoordinate=0)
orient_5 = Orient(Geometry=rotate_2.Geometry, Source=flatten(item_10), Target=pt_6)  # -> Geometry, Transform

number_slider_2 = Slider(0.45, range=0..1)

# ---- group: Nest the Straight Strips
bbox_2 = BoundingBox(Content=rotate.Geometry, Plane=PlaneXY(0, 0, 0))  # -> Box, Box_2
debox_2 = DeconstructBox(Box=bbox_2.Box)  # -> Plane, X, Y, Z
debrep_2 = DeconstructBrep(Brep=bbox_2.Box)  # -> Faces, Edges, Vertices
num_2 = Number(debox_2.X)
item_11 = ListItem(List=debrep_2.Vertices, Index=0, Wrap=True)
addition_2 = Addition(A=num_2, B=Slider(5, range=0..5))
ma_2 = MassAddition(Input=addition_2)  # -> Result, PartialResults
panel_5 = Panel(ma_2.PartialResults)
cull_i_2 = CullIndex(List=ma_2.PartialResults, Indices=Slider(-1, range=-1..0), Wrap=True)
merge_2 = Merge(Data1=Slider(0, range=0..100), Data2=cull_i_2)  # -> flatten(Result)
pt_7 = ConstructPoint(XCoordinate=merge_2, YCoordinate=0, ZCoordinate=0)
orient_6 = Orient(Geometry=rotate.Geometry, Source=flatten(item_11), Target=pt_7)  # -> Geometry, Transform

# ----
addition_3 = Addition(A=merge, B=Slider(40.9, range=0..100))
xy_4 = XYPlane(Origin=pt_6)
item_12 = ListItem(List=orient_6.Geometry, Index=0, Wrap=True)
item_13 = ListItem(List=orient_5.Geometry, Index=0, Wrap=True)
wbnaked_4 = WeaverbirdsNakedBoundary(MeshClosedPolylines=orient_5.Geometry)
patch_4 = Patch(Curves=graft(wbnaked_4), Spans=20, Flexibility=1, Trim=True)  # -> flatten(Patch)
wbnaked_5 = WeaverbirdsNakedBoundary(MeshClosedPolylines=orient_6.Geometry)
md_slider_4 = MDSlider(SliderMode=0, slider_value=Point(0.5, 0.5, 0.5), x_domain=Domain(0, 1), y_domain=Domain(0, 1), z_domain=Domain(0, 1))
patch_5 = Patch(Curves=graft(wbnaked_5), Spans=20, Flexibility=1, Trim=True)  # -> flatten(Patch)
md_slider_5 = MDSlider(SliderMode=0, slider_value=Point(0.5, 0.5, 0.5), x_domain=Domain(0, 1), y_domain=Domain(0, 1), z_domain=Domain(0, 1))
evalsrf_4 = EvaluateSurface(Surface=reparameterize(patch_4), Point=md_slider_5)  # -> Point, Normal, UDirection, VDirection, Frame
evalsrf_5 = EvaluateSurface(Surface=reparameterize(patch_5), Point=md_slider_4)  # -> Point, Normal, UDirection, VDirection, Frame
vdis_4 = VectorDisplay(Anchor=evalsrf_5.Point, Vector=evalsrf_5.Normal)
vdis_5 = VectorDisplay(Anchor=evalsrf_4.Point, Vector=evalsrf_4.Normal)
pl_3 = PlaneNormal(Origin=evalsrf_5.Point, ZAxis=evalsrf_5.Normal)
pl_4 = PlaneNormal(Origin=evalsrf_4.Point, ZAxis=evalsrf_4.Normal)
xy_5 = XYPlane(Origin=evalsrf_4.Point)
xy_6 = XYPlane(Origin=evalsrf_5.Point)
panel_6 = Panel(orient_5.Geometry)
panel_7 = Panel(pl_4)
pt_8 = ConstructPoint(XCoordinate=0, YCoordinate=Slider(7, range=0..10), ZCoordinate=0)
panel_8 = Panel(pl_3)
orient_7 = Orient(Geometry=simplify(orient_5.Geometry), Source=pl_4, Target=xy_5)  # -> Geometry, Transform
number_slider_3 = Slider(8, range=0..100)
xy_7 = XYPlane(Origin=pt_8)
orient_8 = Orient(Geometry=simplify(orient_5.Geometry), Source=xy_5, Target=xy_6)  # -> Geometry, Transform
orient_9 = Orient(Geometry=simplify(orient_6.Geometry), Source=xy_6, Target=xy_5)  # -> Geometry, Transform
addition_4 = Addition(A=merge, B=number_slider_3)
mesh_5 = Mesh(orient_9.Geometry)
X = UnitX(Factor=number_slider_3)
move = Move(Geometry=orient_8.Geometry, Motion=X)  # -> Geometry, Transform
number_slider_4 = Slider(460, range=0..1000)
number_slider_5 = Slider(960, range=0..1000)

# ---- group: Nesting Sheet
rectangle = Rectangle(Plane=PlaneXY(0, 0, 0), XSize=Slider(960, range=0..1000), YSize=Slider(460, range=0..1000), Radius=0)  # -> Rectangle, Length

# ----
mesh_6 = Mesh(move.Geometry)
weave = Weave(Pattern=[0, 1], Stream0=orient_6.Geometry, Stream1=mesh_6, NullGaps=False)
partition = PartitionList(List=weave, Size=Slider(2, range=0..10))
mjoin = MeshJoin(Meshes=partition)  # -> flatten(Mesh)
mesh_7 = Mesh(mjoin)

# ---- group: Scale to mm
bounding_box = BoundingBox(Content=mesh_7, Plane=PlaneXY(0, 0, 0), UnionBox=True)  # -> Box, Box_2
area = Area(Geometry=bounding_box.Box)  # -> Area, Centroid
scale = Scale(Geometry=mesh_7, Center=area.Centroid, Factor=Slider(10, range=0..10))  # -> Geometry, Transform

# ---- group: Flaps (Optional)
pi = Pi(Factor=Slider(0.3, range=0..1))
flapper = Flapper(Mesh=scale.Geometry, TaperingAngle=pi, OffsetDistance=Slider(5, range=0..10))  # -> FoldInnerEdges, FoldOuterEdges, CutLines
curve = Curve(flapper.FoldInnerEdges)
curve_2 = Curve(flapper.FoldOuterEdges)
curve_3 = Curve(flapper.CutLines)
join_curves = JoinCurves(Curves=curve_2, Preserve=False)
geometry = Geometry([curve, join_curves])

# ---- group: Texto to Engrave
mesh_area = MeshArea(Mesh=scale.Geometry)  # -> Area, graft(Centroid)
face_normals = FaceNormals(Mesh=scale.Geometry)  # -> Centers, Normals
closest_point = ClosestPoint(Point=mesh_area.Centroid, Cloud=face_normals.Centers)  # -> ClosestPoint, CPIndex, Distance
tree_statistics = TreeStatistics(Tree=simplify(closest_point.ClosestPoint))  # -> Paths, Length, Count
deconstruct_path = DeconstructPath(Branch=tree_statistics.Paths)
text = Text(Location=closest_point.ClosestPoint, Text=deconstruct_path, Size=Slider(5, range=0..10), Font="SLF-RHN Architect")

# ---- group: Open Nest Optimization
options = Options(
    Rotations=Slider(2, range=0..360),
    Wiggle=Slider(0, range=0..5.01),
    PlacementType=Slider(0, range=0..2),
    Spacing=Slider(1, range=0..100),
    Seed=Slider(20, range=0..100),
    SimplifyTolerance=Slider(1, range=0.01..10),
    Mutation=Slider(10, range=1..100),
    Population=Slider(10000, range=1..100000),
    Time=Slider(0, range=0..120),
    SheetFont="MecSoft_Font-1 -10")

curve_4 = Curve(curve_3)
geometry_2 = Geometry(Outlines=curve_4, Simplify="-100", Hull=invert(True), Copies="1")  # -> Geometry, Borders

# ----
panel_9 = Panel(geometry)
geometry_3 = Geometry(join_curves)
geometry_4 = Geometry(curve)

# ---- group: Open Nest Optimization
curve_5 = Curve(rectangle.Rectangle)
opennest_run = BooleanToggle(True)

sheets = Sheets(Polylines=curve_5, Gap=Slider(10, range=10..100), Rows=Slider(1, range=1..20), Copies=Slider(5, range=1..1000))  # -> Sheets, Polylines

opennest2 = OpenNest2(Sheets=sheets.Sheets, Geometry=geometry_2.Geometry, Options=options, Iterations=Slider(1, range=0..20), Run=opennest_run)  # -> Sheets, Borders, AllGeo, Transforms, SheetId, SheetTxt, Attributes

# ----
panel_10 = Panel(opennest2.Transforms)
geometry_5 = Geometry(opennest2.Sheets)
transform = Transform(Geometry=simplify(geometry_3), Transform=opennest2.Transforms)
transform_2 = Transform(Geometry=simplify(geometry_4), Transform=opennest2.Transforms)
transform_3 = Transform(Geometry=simplify(text), Transform=opennest2.Transforms)
geometry_6 = Geometry(opennest2.AllGeo)

entwine = Entwine(Branch00=geometry_6, Branch02=[transform, transform_3, transform_2], Branch03=geometry_5, FlattenInputs=True)

panel_11 = Panel("""ExteriorCut
InteriorCut
Engraving
Pages""")
panel_12 = Panel("""Yellow
Red
Green
Magenta""")
value_list = ValueList({"By Layer": 0, "By Object": 1, "By Material": 2, "By Parent": 3}, selected="By Layer")
display_colour = DisplayColour(Source=value_list)  # -> DisplayColour, Source, Colour
concatenate = Concatenate(FragmentA="LASERCUT::", FragmentB=panel_11)
model_layer = ModelLayer(Name=concatenate, DisplayColour=panel_12)  # -> graft(Layer), Name, Hidden, Locked, DisplayColour, Material, Linetype, PrintColour, PrintWidth
display_attributes = DisplayAttributes(DisplayColour=display_colour.DisplayColour)  # -> Display, DisplayColour, DisplayMode
model_object = ModelObject(Object=entwine, Layer=model_layer.Layer, Display=display_attributes.Display)  # -> Object, Geometry, Name, Layer, Visibility, Display, Drafting, Render
bake3d_rhino8 = Button()
content_cache = ContentCache(Content=model_object.Object, Action=bake3d_rhino8)
