# Grasshopper definition Grasshopper-Assignment-04.gh (Grasshopper 1.0.8)

panel = Panel("C:\Users\jaume\Documents\GitHub\Rhino-Grasshopper-Scripts\AT-AP-Sessions\Session-4\qodo\assignment01.py")
number_slider = Slider(10, range=0..10)
path = FilePath(panel)
# Shift right click for input param
file = ReadFile(File=path, PerLineParse=False)
py3 = Python3Script(script=file, x_points=number_slider, y_points=number_slider)  # -> out, a, b, c, d, e, f, g
pt = Point(py3.a)
pt_2 = Point(py3.b)
line = Line(py3.c)
crv = Curve(py3.e)
brep = Brep(py3.f)
mesh = Mesh(py3.g)
pt_3 = Point(py3.d)
panel_2 = Panel(brep)
